# Dynamo graph CreateSheets.dyn (Dynamo 1.3.4.6666)

file_path = Filename(".\CreateSheets.xlsx")
fromPath = FileObject(file_path)  # "File.FromPath"
code_block = CodeBlock { "Sheet1"; }
boolean = BoolSelector(true)
readFromFile = Excel.ReadFromFile(file=fromPath, sheetName=code_block, readAsStrings=boolean)
transpose = List.Transpose(readFromFile)
code_block_2 = CodeBlock { 0; 1; }
getItemAtIndex = List.GetItemAtIndex(list=transpose, index=code_block_2.out1)
getItemAtIndex_2 = List.GetItemAtIndex(list=transpose, index=code_block_2.out0)
family_types = FamilyTypes("30x42_Firm_Titleblock:M-ENG")
code_block_3 = CodeBlock { 48; }
ofRepeatedItem = List.OfRepeatedItem(item=family_types, amount=code_block_3)
views = Views("Project Setup-01")
byNameNumberTitleBlockAndView = Sheet.ByNameNumberTitleBlockAndView(sheetName=getItemAtIndex, sheetNumber=getItemAtIndex_2, titleBlockFamilyType=ofRepeatedItem, view=views)
