# Dynamo graph grid head changer.dyn (Dynamo 0.9.2.4472)

# group: User Inputs
# note: Switch this each time you run to refresh the active view
reset_refresh_slider = IntegerSlider(1, range=0..1 step 1)
# note: Draw and Select a Spline that intersects the Grids nearest the end you want to change
select_model_element = DSModelElementSelection()  # 1 picked in the model
# note: Set to "0" to Hide the Bubbles
# Set to "1" to Show the Bubbles
hidebubble_0_showbubble_1 = IntegerSlider(1, range=0..1 step 1)

python_script = Python(IN[0]=reset_refresh_slider)
# ---------- python_script.python (55 lines) ----------
import clr
clr.AddReference('RevitAPI')
from Autodesk.Revit.DB import *
import Autodesk
from System.Collections.Generic import *

clr.AddReference('ProtoGeometry')
from Autodesk.DesignScript.Geometry import *


clr.AddReference("RevitNodes")
import Revit
clr.ImportExtensions(Revit.Elements)
clr.ImportExtensions(Revit.GeometryConversion)

clr.AddReference("RevitServices")
import RevitServices
from RevitServices.Persistence import DocumentManager
from RevitServices.Transactions import TransactionManager

clr.AddReference("DSCoreNodes")
from DSCore import*

clr.AddReference("System")
from System.Collections.Generic import *
import System.Object

doc = DocumentManager.Instance.CurrentDBDocument
uiapp = DocumentManager.Instance.CurrentUIApplication
app = uiapp.Application

viewel = doc.ActiveView
#The inputs to this node will be stored as a list in the IN variables.
dataEnteringNode = IN

reset = IN[0]

gridgeom = list()

gridfilt = ElementCategoryFilter(BuiltInCategory.OST_Grids)
viewId = viewel.Id

if reset >-1:
	gridelementsinview = FilteredElementCollector(doc,viewId).WherePasses(gridfilt).WhereElementIsNotElementType().ToElements()
	
for g in gridelementsinview:
	try:
		viewgridlines = g.GetCurvesInView(Autodesk.Revit.DB.DatumExtentType.ViewSpecific,viewel)
	except:
		viewgridlines =g.GetCurvesInView(Autodesk.Revit.DB.DatumExtentType.Model,viewel)
	gridgeom.append(viewgridlines[0].ToProtoType())


#Assign your output to the OUT variable.
OUT = gridelementsinview,gridgeom
# ----------------------------------------
code_block = CodeBlock(x=python_script) { x[0]; x[1]; }
intersect = Geometry.Intersect()
geometry = Element.Geometry(select_model_element)
startPoint = Curve.StartPoint(code_block.out1)
Z = Point.Z(startPoint)
startPoint_2 = Curve.StartPoint(geometry)
Z_2 = Point.Z(startPoint_2)
sub = Z - Z_2  # lacing=Longest
translate = Geometry.Translate(geometry=geometry, zTranslation=sub, lacing=Longest)
combine = List.Combine(intersect, code_block.out1, translate)
firstItem = List.FirstItem()
map = List.Map(list=combine, f_x=firstItem)
isNull = Object.IsNull(map)
filterByBoolMask = List.FilterByBoolMask(list=code_block.out0, mask=isNull)
filterByBoolMask_2 = List.FilterByBoolMask(list=code_block.out1, mask=isNull)
filterByBoolMask_3 = List.FilterByBoolMask(list=map, mask=isNull)
parameterAtPoint = Curve.ParameterAtPoint(curve=filterByBoolMask_2.out, point=filterByBoolMask_3.out)
python_script_2 = Python(IN[0]=filterByBoolMask.out, IN[1]=parameterAtPoint, IN[2]=hidebubble_0_showbubble_1)
# ---------- python_script_2.python (64 lines) ----------
import clr
clr.AddReference('RevitAPI')
from Autodesk.Revit.DB import *
import Autodesk


clr.AddReference('ProtoGeometry')
from Autodesk.DesignScript.Geometry import *


clr.AddReference("RevitNodes")
import Revit
clr.ImportExtensions(Revit.Elements)
clr.ImportExtensions(Revit.GeometryConversion)

clr.AddReference("RevitServices")
import RevitServices
from RevitServices.Persistence import DocumentManager
from RevitServices.Transactions import TransactionManager

clr.AddReference("DSCoreNodes")
from DSCore import*

clr.AddReference("System")
from System.Collections.Generic import *
import System.Object

doc = DocumentManager.Instance.CurrentDBDocument
uiapp = DocumentManager.Instance.CurrentUIApplication
app = uiapp.Application

viewel = doc.ActiveView
#The inputs to this node will be stored as a list in the IN variables.
dataEnteringNode = IN

gridz = UnwrapElement(IN[0])
pointparamz = IN[1]
showhide =IN[2]

gridgeom = list()

#gridfilt = ElementCategoryFilter(BuiltInCategory.OST_Grids)
#viewId = viewel.Id

TransactionManager.Instance.EnsureInTransaction(doc)
for i in range(0,len(gridz)):
	g=gridz[i]
	p=pointparamz[i]
	if p<0.5:
		if showhide == 0:
			g.HideBubbleInView(DatumEnds.End0,viewel)
		else:
			g.ShowBubbleInView(DatumEnds.End0,viewel)
	else:
		if showhide == 0:
			g.HideBubbleInView(DatumEnds.End1,viewel)
		else:
			g.ShowBubbleInView(DatumEnds.End1,viewel)
			
TransactionManager.Instance.TransactionTaskDone()


#Assign your output to the OUT variable.
OUT = gridz
# ----------------------------------------
